# Grasshopper definition TopologicalVoxelization_SampleGH_Implementation_1.gh (Grasshopper 0.9.76)
# Copyright: All rights reserved

# ---- group: Configure your own file path
format = Format(Format="{0}/{1}.txt", Culture=127, Data0="D:\OTB_Data\BatchVoxels", Data1="Bentley_{1,1,1}")
panel = Panel(format)

# ---- group: A Curve for Demo
curve = Curve(<curve referenced from the Rhino model>)
topoly = CurveToPolyline(Curve=curve, ToleranceDistance=Slider(0.1, range=0..1), ToleranceAngle=Slider(0.1, range=0..1))  # -> Polyline, Segments

# ---- group: inputMeshes_from Bentley Building
id = Guid([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])

# ----
u = Slider(1, range=0..1)
v = Slider(1, range=0..1)
w = Slider(1, range=0..1)

# ---- group: Another model for demo
brep = Brep(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)
swatch = ColourSwatch(SwatchColor=RGB(18, 227, 227))
mesh = Mesh(brep)

# ----
identifier = VBScript(id=id)  # -> out, ST, SC, RM; inputs id: Guid
# ---------- identifier: VB ----------
    Component.Params.Output(1).name = "SemanticTags"
    Component.Params.Output(1).nickname = "ST"
    Component.Params.Output(1).description = "tags read from layer names of objects; if not satisfied with tags, try to change layer names or provide an alternative list"
    Component.Params.Output(2).name = "SemanticColors"
    Component.Params.Output(2).nickname = "SC"
    Component.Params.Output(2).description = "colors read from layer names of objects; if not satisfied with colors, try to change layer colors or provide an alternative list"
    Component.Params.Output(3).name = "ResultMesh"
    Component.Params.Output(3).nickname = "RM"
    Component.Params.Output(3).description = "meshes read from file"
    Dim obj As Rhino.DocObjects.RhinoObject = RhinoDocument.Objects.Find(id)
    If obj Is Nothing Then
      Return
    End If
    Dim SemanticTag As String
    Dim SemanticCol As Color
    ' Dim LayerID As Integer

    Dim MObject As Rhino.DocObjects.MeshObject = TryCast(obj, Rhino.DocObjects.MeshObject)
    Dim BObject As Rhino.DocObjects.BrepObject = TryCast(obj, Rhino.DocObjects.BrepObject)
    Dim RObj As Rhino.DocObjects.RhinoObject = TryCast(obj, Rhino.DocObjects.RhinoObject)
    Dim MT As MeshType = MeshType.Any
    '    If RObj.IsMeshable(MT) Then
    '      Dim MP As MeshingParameters = MeshingParameters.Default
    '      Dim EqM As Integer = RObj.MeshCount(MT, New MeshingParameters)
    '    End If
    '    Dim RDO As ObjectAttributes
    '    RDO.
    '
    Dim ResultMesh As New mesh
    If Not Obj.IsMeshable(MT) Then
      Return
    Else If MObject Is Nothing Then
      Dim Meshes As List(Of Mesh) = Obj.GetMeshes(MT).ToList
      For Each MO As mesh In Meshes
        resultMesh.Append(MO)
      Next
      Dim ObjAttributes As ObjectAttributes
      ObjAttributes = Obj.Attributes
      ObjAttributes.ColorSource = ObjectColorSource.ColorFromObject'ColorFromLayer
      SemanticTag = Rhino.RhinoDoc.ActiveDoc.Layers(ObjAttributes.LayerIndex).Name'ToString
      'LayerID = ObjAttributes.LayerIndex
      SemanticCol = Rhino.RhinoDoc.ActiveDoc.Layers(ObjAttributes.LayerIndex).Color
    Else
      ResultMesh = MObject.Geometry
      Dim ObjAttributes As ObjectAttributes
      ObjAttributes = MObject.Attributes
      SemanticTag = Rhino.RhinoDoc.ActiveDoc.Layers(ObjAttributes.LayerIndex).ToString
      ' LayerID = ObjAttributes.LayerIndex
      SemanticCol = Rhino.RhinoDoc.ActiveDoc.Layers(ObjAttributes.LayerIndex).Color
    End If

    SC = SemanticCol
    ST = SemanticTag
    RM = ResultMesh

    ' LayID = LayerID
# ---------- end identifier ----------

# ---- group: Stanford Bunny
lil_bunny = Mesh(<mesh referenced from the Rhino model>)
panel_2 = Panel(lil_bunny)

# ---- group: GUID of the example Point Cloud in the scene
# Developed by Pirouz Nourian,
# PhD researcher & Instructor
# Urban Design Informatics
# TU Delft, Faculty of Architecture and the Built Environment
# p.nourian@tudelft.nl
# No guarantees whatsoever! Use at your own risk!
id_2 = Guid(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)

# ----
# Point Cloud to Voxels
number_slider = Slider(0.5, range=0..1)
number_slider_2 = Slider(0.5, range=0..1)
number_slider_3 = Slider(0.5, range=0..1)
Y = UnitY(Factor=expr("-x", Slider(14, range=0..100)))
c_script = CSharpScript(id=id_2, Sx=number_slider, Sy=number_slider_2, Sz=number_slider_3)  # -> out, A, B; inputs id: Guid, Sx: Double, Sy: Double, Sz: Double
# ---------- c_script: C# ----------
    object obj = RhinoDocument.Objects.Find(id);
    Rhino.DocObjects.PointCloudObject cloudObject = obj as Rhino.DocObjects.PointCloudObject;
    if (cloudObject == null)
    {
      return;
    }
    PointCloud cloud = cloudObject.PointCloudGeometry;
    //    var PCO = new { PC = cloud };
    //    A = PCO;
    //cloudObject.PointCloudGeometry
    //Get Bounding Box of Mesh and find the X,Y,Z extents discritizations:
    BoundingBox BB = cloud.GetBoundingBox(false);
    //M.GetBoundingBox(True)
    Vector3d VSize = new Vector3d(Sx, Sy, Sz);
    BoundingBox Zbbox = RBBox_to_ZBBox(BB, VSize);
    int CX = Convert.ToInt32(Math.Floor((Zbbox.Max.X - Zbbox.Min.X) / Sx));
    int CY = Convert.ToInt32(Math.Floor((Zbbox.Max.Y - Zbbox.Min.Y) / Sy));
    int CZ = Convert.ToInt32(Math.Floor((Zbbox.Max.Z - Zbbox.Min.Z) / Sz));
    bool[,,] Voxels3I = new bool[CX + 1, CY + 1, CZ + 1];
    List<Point3d> VoxelsOut = new List<Point3d>();
    //FileSystem.Print(string.Format("{0},{1},{2}", CX, CY, CZ));
    foreach (Point3d point in cloud.GetPoints()) {
      int i = Convert.ToInt32(Math.Floor((point.X - Zbbox.Min.X) / Sx));
      int j = Convert.ToInt32(Math.Floor((point.Y - Zbbox.Min.Y) / Sy));
      int k = Convert.ToInt32(Math.Floor((point.Z - Zbbox.Min.Z) / Sz));
      if (!Voxels3I[i, j, k])
      {
        Voxels3I[i, j, k] = true;
        Point3d VoxelOut = new Point3d(i * Sx, j * Sy, k * Sz) + VSize / 2 + Zbbox.Min;
        VoxelsOut.Add(VoxelOut);
      }
    }

    A = VoxelsOut;
    B = Voxels_to_Boxels(VoxelsOut.ToArray(), new Vector3d(Sx, Sy, Sz));
# ---------- c_script: C# additional code ----------
  public BoundingBox RBBox_to_ZBBox(BoundingBox RBbox, Vector3d VSize)
  {
    Point3d ZMinP = MinBoundRP_to_ZP(RBbox.Min, VSize);
    Point3d ZMaxP = MaxBoundRP_to_ZP(RBbox.Max, VSize);
    BoundingBox ZBBox = new BoundingBox(ZMinP, ZMaxP);
    return ZBBox;
  }
  public Point3d RPtoZP(Point3d RPoint, Vector3d VSize)
  {
    Point3d ZPOint = new Point3d((Math.Floor(RPoint.X / VSize.X) + 0.5) * VSize.X, (Math.Floor(RPoint.Y / VSize.Y) + 0.5) * VSize.Y, (Math.Floor(RPoint.Z) / VSize.Z + 0.5) * VSize.Z);
    return ZPOint;
  }
  private Point3d MaxBoundRP_to_ZP(Point3d RPoint, Vector3d VSize)
  {
    double x = 0;    double y = 0;    double z = 0;
    double u = 0;    double v = 0;    double w = 0;
    double ZP_x = 0;    double ZP_y = 0;    double ZP_z = 0;
    x = RPoint.X;    y = RPoint.Y;    z = RPoint.Z;
    u = VSize.X;    v = VSize.Y;    w = VSize.Z;
    ZP_x = Math.Ceiling(x / u) * u;
    ZP_y = Math.Ceiling(y / v) * v;
    ZP_z = Math.Ceiling(z / w) * w;
    Point3d ZPoint = new Point3d(ZP_x, ZP_y, ZP_z);
    return ZPoint;
  }
  private Point3d MinBoundRP_to_ZP(Point3d RPoint, Vector3d VSize)
  {
    double x = 0;    double y = 0;    double z = 0;
    double u = 0;    double v = 0;    double w = 0;
    double ZP_x = 0;    double ZP_y = 0;    double ZP_z = 0;
    x = RPoint.X;
    y = RPoint.Y;
    z = RPoint.Z;
    u = VSize.X;
    v = VSize.Y;
    w = VSize.Z;
    ZP_x = Math.Floor(x / u) * u;
    ZP_y = Math.Floor(y / v) * v;
    ZP_z = Math.Floor(z / w) * w;
    Point3d ZPoint = new Point3d(ZP_x, ZP_y, ZP_z);
    return ZPoint;
  }
  public object Voxels_to_Boxels(Point3d[] VoxelPoints, Vector3d VSize)
  {
    List<Mesh> Cubes = new List<Mesh>();
    double u = 0;    double v = 0;    double w = 0;
    u = VSize.X / 2;    v = VSize.Y / 2;    w = VSize.Z / 2;

    foreach (Point3d voxelPoint in VoxelPoints) {
      Point3d xp = voxelPoint;
      Point3d[] VX = new Point3d[8];
      VX[0] = xp - new Vector3d(+u, +v, +w);
      VX[1] = xp - new Vector3d(-u, +v, +w);
      VX[2] = xp - new Vector3d(-u, -v, +w);
      VX[3] = xp - new Vector3d(+u, -v, +w);
      VX[4] = xp + new Vector3d(-u, -v, +w);
      VX[5] = xp + new Vector3d(+u, -v, +w);
      VX[6] = xp + new Vector3d(+u, +v, +w);
      VX[7] = xp + new Vector3d(-u, +v, +w);
      Mesh Cube = Mesh.CreateFromBox(VX, 1, 1, 1);
      //Cube.VertexColors.CreateMonotoneMesh(Voxel.SemanticToColor(SemanticTags, SemanticColors, vxl.SemanticIndex))
      //Cube.VertexColors.CreateMonotoneMesh(Color.black)
      Cubes.Add(Cube);
    }
    return Cubes;
  }
# ---------- end c_script ----------
vec = VectorXYZ(XComponent=number_slider, YComponent=number_slider_2, ZComponent=number_slider_3)  # -> Vector, Length
move = Move(Geometry=c_script.B, Motion=Y)  # -> Geometry, Transform
boxels = VBScript(V=c_script.A, S=vec.Vector)  # -> out, B; inputs V: list of Point3d, S: Vector3d
# ---------- boxels: VB ----------
    B = Voxels_to_Boxels(V.toArray, S)
# ---------- boxels: VB additional code ----------
  Function Voxels_to_Boxels(VoxelPoints As Point3d(), VSize As Vector3d)
    Dim Cubes As New List(Of Mesh)
    Dim u,v,w As Double
    u = Vsize.X / 2
    v = Vsize.Y / 2
    w = Vsize.Z / 2

    For Each voxelPoint As Point3d In VoxelPoints
      Dim xp As point3d = voxelPoint
      Dim VX(7) As Point3d
      VX(0) = xp - New Vector3d(+u, +v, +w)
      VX(1) = xp - New Vector3d(-u, +v, +w)
      VX(2) = xp - New Vector3d(-u, -v, +w)
      VX(3) = xp - New Vector3d(+u, -v, +w)
      VX(4) = xp + New Vector3d(-u, -v, +w)
      VX(5) = xp + New Vector3d(+u, -v, +w)
      VX(6) = xp + New Vector3d(+u, +v, +w)
      VX(7) = xp + New Vector3d(-u, +v, +w)
      Dim Cube As Mesh = Mesh.CreateFromBox(VX, 1, 1, 1)
      'Cube.VertexColors.CreateMonotoneMesh(Voxel.SemanticToColor(SemanticTags, SemanticColors, vxl.SemanticIndex))
      'Cube.VertexColors.CreateMonotoneMesh(Color.black)
      Cubes.Add(Cube)
    Next
    Return Cubes
  End Function
  'Public Function vxlList2Cubes(SemanticColors As List(Of Color), SemanticTags As List(Of Integer)) As List(Of Mesh)
  '    Dim u As Double
  '    u = Me.vSize / 2
  '
  '    Dim Cubes As New List(Of Mesh)
  '    For Each vxl As Voxel In Me.vxlList
  '      Dim xp As Point3d = vxl.getCenter(Me.offset, Me.vSize)
  '      Dim VX(7) As Point3d
  '      VX(0) = xp - New Vector3d(u, u, u)
  '      VX(1) = xp - New Vector3d(-u, u, u)
  '      VX(2) = xp - New Vector3d(-u, -u, u)
  '      VX(3) = xp - New Vector3d(u, -u, u)
  '      VX(4) = xp + New Vector3d(-u, -u, u)
  '      VX(5) = xp + New Vector3d(u, -u, u)
  '      VX(6) = xp + New Vector3d(u, u, u)
  '      VX(7) = xp + New Vector3d(-u, u, u)
  '      Dim Cube As Mesh = Mesh.CreateFromBox(VX, 1, 1, 1)
  '      Cube.VertexColors.CreateMonotoneMesh(Voxel.SemanticToColor(SemanticTags, SemanticColors, vxl.SemanticIndex))
  '      Cubes.Add(Cube)
  '    Next
  '    Return Cubes
  '  End Function
# ---------- end boxels ----------
preview = CustomPreview(Geometry=move.Geometry, Shader=ColourSwatch(SwatchColor=RGB(158, 158, 158)))
mv = MV_2(G=move.Geometry)

# ---- group: 2D input
_2d_input_mesh = Mesh(lil_bunny)
sx = Y(u)
sy = Z(v)
sz = U(w)
panel_3 = Panel("Surface to Voxels")  # disabled
E = E(M=_2d_input_mesh)
value_list = ValueList({"26-Connected": 26, "6-Connected": 6}, selected="26-Connected")
topovoxels = VBScript(CO=value_list, M=_2d_input_mesh, Sx=sx, Sy=sy, Sz=sz)  # -> out, A, V, S; inputs M: Mesh
# ---------- topovoxels: VB ----------
    Dim VSize As  New Vector3d(Sx, Sy, Sz)

    V = VoxelizeMesh(M, VSize, CO)
    S = VSize
# ---------- topovoxels: VB additional code ----------
  Function VoxelizeMesh(M As Mesh, Vsize As Vector3d, CO As Integer)
    Dim RBBox As Boundingbox = M.GetBoundingBox(False) 'bounding box in R (real numbers)
    Dim ZBBox As BoundingBox = RBBox_to_ZBBox(RBbox, VSize) 'boudning box in Z (integer numbers)

    Dim gridpoints As list(Of point3d) = BBoxToVoxels(ZBBox, Vsize)

    Dim Mesh_NearPoints = NearPoints(GridPoints, M, VSize.Length / 2)
    'A = Mesh_NearPoints
    Dim Voxels As New list(Of Point3d)

    Dim Intarget As Line() = Nothing
    Dim Facets As Integer()=Nothing
    For Each gridpoint As point3d In Mesh_NearPoints' for each potential voxel check if it has to be included in the raster
      If CO = 26 Then
        Intarget = MeshTarget26_Connected(gridpoint, VSize)
      ElseIf CO = 6 Then
        Intarget = MeshTarget06_Connected(gridpoint, VSize)
      Else
        print("connectivity target undefined!")
      End If
      Dim Intersections() As line = Array.FindAll(Intarget, Function(lambda) Rhino.Geometry.Intersect.Intersection.MeshLine(M, Lambda, facets).Length > 0)
      If Intersections.length > 0 Then
        Voxels.Add(GridPoint)
      End If
    Next
    return Voxels
  End Function
  Function MeshToTriangles(ByVal M As Mesh) As Mesh()
    M.Faces.ConvertQuadsToTriangles
    Dim Meshes As Mesh()
    M.Unweld(0, False)
    Meshes = M.ExplodeAtUnweldedEdges()
    Return Meshes
  End Function
  Function RBBox_to_ZBBox(RBbox As BoundingBox, VSize As Vector3d) As Boundingbox
    Dim ZMinP As point3d = MinBoundRP_to_ZP(RBBox.Min, VSize)
    Dim ZMaxP As point3d = MaxBoundRP_to_ZP(RBBox.Max, VSize)
    Dim ZBBox As New BoundingBox(ZMinP, ZMaxP)
    Return ZBBox
  End Function
  Function RPtoZP(RPoint As point3d, VSize As Vector3d) As point3d
    Dim ZPOint As New Point3d((Math.Floor(RPoint.x / VSize.X) + 0.5) * VSize.X, (Math.Floor(RPoint.y / VSize.Y) + 0.5) * VSize.Y, (Math.Floor(Rpoint.z) / VSize.Z + 0.5) * VSize.Z)
    Return ZPoint
  End Function
  Private Function MaxBoundRP_to_ZP(RPoint As point3d, VSize As Vector3d)
    Dim x,y,z,u,v,w,ZP_x,ZP_y,ZP_z As Double
    x = Rpoint.x
    y = RPoint.Y
    z = RPoint.z
    u = Vsize.X
    v = Vsize.Y
    w = Vsize.Z
    ZP_x = Math.Ceiling(x / u) * u
    ZP_y = Math.Ceiling(y / v) * v
    ZP_z = Math.Ceiling(z / w) * w
    Dim ZPoint As New Point3d(ZP_x, ZP_y, ZP_z)
    Return ZPoint
  End Function
  Private Function MinBoundRP_to_ZP(RPoint As point3d, VSize As Vector3d)
    Dim x,y,z,u,v,w,ZP_x,ZP_y,ZP_z As Double
    x = Rpoint.x
    y = RPoint.Y
    z = RPoint.z
    u = Vsize.X
    v = Vsize.Y
    w = Vsize.Z
    ZP_x = Math.Floor(x / u) * u
    ZP_y = Math.Floor(y / v) * v
    ZP_z = Math.Floor(z / w) * w
    Dim ZPoint As New Point3d(ZP_x, ZP_y, ZP_z)
    Return ZPoint
  End Function
  Function BBoxToVoxels(ZBBox As boundingbox, Vsize As Vector3d) As list(Of point3d)
    Dim i,j,k,Imax, Jmax, Kmax As Integer
    IMax = Math.Abs(ZBBox.Diagonal.X / Vsize.x) - 1
    JMax = Math.Abs(ZBBox.Diagonal.Y / Vsize.y) - 1
    KMax = Math.Abs(ZBBox.Diagonal.Z / Vsize.z) - 1
    'Dim VoxelPoints(IMax,JMax,KMax) As Point3d
    Dim VoxelPoints As New list(Of point3d)
    For k = 0 To Kmax
      For j = 0 To Jmax
        For i = 0 To IMax
          Dim RelPoint As New Point3d(i * VSize.x, j * VSize.y, k * Vsize.z)
          'VoxelPoints(i, j, k) = (RelPoint + New Vector3d(ZBbox.Min) + New Vector3d(VSize(0), VSize(1), VSize(2)) * 0.5)
          VoxelPoints.Add((RelPoint + New Vector3d(ZBbox.Min) + New Vector3d(VSize(0), VSize(1), VSize(2)) * 0.5))
        Next
      Next
    Next
    Return VoxelPoints
  End Function
  Function MeshTarget26_Connected(VoxelPoint As Point3d, Vsize As Vector3d)'3D crosshair target for 26-connected results
    Dim IntersectionTarget(2) As Line
    Dim Vertices(5) As Point3d
    Dim u,v,w As Double
    u = VSize.X / 2
    v = Vsize.Y / 2
    w = Vsize.Z / 2
    Vertices(0) = VoxelPoint + New Vector3d(+u, 00, 00)
    Vertices(1) = VoxelPoint + New Vector3d(00, +v, 00)
    Vertices(2) = VoxelPoint + New Vector3d(00, 00, +w)
    Vertices(3) = VoxelPoint + New Vector3d(-u, 00, 00)
    Vertices(4) = VoxelPoint + New Vector3d(00, -v, 00)
    Vertices(5) = VoxelPoint + New Vector3d(00, 00, -w)
    For i As Integer=0 To 2
      IntersectionTarget(i) = New Line(Vertices(i), Vertices(i + 3))
    Next
    Return IntersectionTarget
  End Function
  Function MeshTarget06_Connected(VP As Point3d, Vsize As Vector3d)'cube outline target for 6-connected results
    Dim IT(11) As Line
    Dim VX(7) As Point3d
    Dim u,v,w As Double
    u = VSize.X / 2
    v = Vsize.Y / 2
    w = Vsize.Z / 2

    VX(0) = VP + New Vector3d(+u, +v, +w)
    VX(1) = VP + New Vector3d(-u, +v, +w)
    VX(2) = VP + New Vector3d(-u, -v, +w)
    VX(3) = VP + New Vector3d(+u, -v, +w)
    VX(4) = VP + New Vector3d(-u, -v, -w)
    VX(5) = VP + New Vector3d(+u, -v, -w)
    VX(6) = VP + New Vector3d(+u, +v, -w)
    VX(7) = VP + New Vector3d(-u, +v, -w)
    'cube edges
    IT(00) = New Line(VX(0), VX(1))
    IT(01) = New Line(VX(1), VX(2))
    IT(02) = New Line(VX(2), VX(3))
    IT(03) = New Line(VX(3), VX(0))
    IT(04) = New Line(VX(0), VX(6))
    IT(05) = New Line(VX(6), VX(5))
    IT(06) = New Line(VX(5), VX(4))
    IT(07) = New Line(VX(4), VX(7))
    IT(08) = New Line(VX(5), VX(3))
    IT(09) = New Line(VX(4), VX(2))
    IT(10) = New Line(VX(1), VX(7))
    IT(11) = New Line(VX(6), VX(7))

    Return IT
  End Function
  Function NearPoints(ByVal x As List(Of Point3d), ByVal y As Curve, Distance As Double) As list(Of point3d)
    Dim AllPoints As list(Of Point3d) = x
    Dim t As Double
    Dim RelevantPoints As list(Of Point3d) = AllPoints.findAll(Function(lambda) y.closestPoint(lambda, t, Distance))
    Return RelevantPoints
  End Function
  Function NearPoints(ByVal x As List(Of Point3d), ByVal y As Mesh, Distance As Double)
    Dim AllPoints As list(Of Point3d) = x
    Dim MP As point3d
    Dim RelevantPoints As list(Of Point3d) = AllPoints.findAll(Function(lambda) Not y.closestPoint(lambda, MP, Distance))
    Return RelevantPoints
  End Function
# ---------- end topovoxels ----------
boxels_2 = VBScript(V=topovoxels.V, S=topovoxels.S)  # -> out, B; inputs V: list of Point3d, S: Vector3d; same code as boxels
hull = VBScript(x=boxels_2.B)  # -> out, H; inputs x: list of Mesh; disabled
# ---------- hull: VB ----------
    Dim BigMesh As New Mesh
    Dim FaceCenters As New list(Of point3d)
    Dim Tolerance As Double = 0.01
    For Each boxel As mesh In x
      BigMesh.Append(boxel)
      For i As Integer= 0 To 5'Each face As meshface In boxel.Faces
        FaceCenters.Add(boxel.Faces.GetFaceCenter(i))
      Next
    Next
    Dim HullsFaceList As New list(Of meshFace)
    For k As Integer=0 To BigMesh.Faces.Count - 1
      Dim thisCenter As point3d = BIgMesh.Faces.GetFaceCenter(k)
      Dim SimilarFaceCount As Integer = FaceCenters.findAll(Function(lambda) lambda.epsilonEquals(thisCenter, Tolerance)).count
      'Print(SimilarFaceCount)
      If SimilarFaceCount = 1 Then HullsFaceList.Add(BIgMesh.Faces(k))
    Next

    Dim Hulls As New Mesh
    Hulls.Vertices.AddVertices(BigMesh.Vertices)
    Hulls.Faces.AddFaces(HullsFaceList)
    Hulls.Compact
    'Hulls.Weld(Math.PI)
    Dim TwoHulls() As Mesh = Hulls.SplitDisjointPieces()'Hulls.ExplodeAtUnweldedEdges()
    Dim S1 As Integer = TwoHulls(0).Vertices.Count
    Dim S2 As Integer = TwoHulls(1).Vertices.Count
    Dim outershell As mesh
    If s1 = Math.Max(s1, s2) Then
      outershell = TwoHulls(0)
    Else
      outershell = TwoHulls(1)
    End If
    'Outershell.Unweld(Math.PI, False)

    'A = BigMesh
    H = OuterShell
    'B = FaceCenters
    'C = Hulls
# ---------- end hull ----------
mv_2 = MV(G=boxels_2.B)

# ---- group: layers of the Bentley Building
coltag = VBScript(ST=identifier.ST, SC=identifier.SC)  # -> Col, Tag; inputs ST: list, SC: list of Color
# ---------- coltag: VB ----------
    Dim SmTags As New List(Of String)
    Dim SmCols As New list(Of Color)

    For k As Integer=0 To ST.Count - 1
      If Not SmTags.contains(ST(k)) Then
        SmTags.Add(ST(k))
        SmCols.Add(SC(k))
      End If
    Next
    Col = SmCols
    Tag = SmTags
# ---------- end coltag ----------
legend = Legend(Colour=coltag.Col, Tags=coltag.Tag, LegendType=1)

# ----
cracklargemeshes = CSharpScript(M=identifier.RM, C=identifier.SC, n=Slider(50, range=0..100), x=sx, y=sy, z=sz)  # -> out, flatten(Ms), flatten(Cs); inputs M: Mesh, C: Color, n: Int32, x: Double, y: Double, z: Double
# ---------- cracklargemeshes: C# ----------
    Vector3d SizeVector = new Vector3d(x, y, z);
    double sizeIndicator = SizeVector.Length;
    BoundingBox BB = M.GetBoundingBox(false);
    if(BB.Diagonal.Length > (n * sizeIndicator))
    {
      Print("this mesh is big, so I will crack it!");
      Mesh Sample = new Mesh();
      Sample.CopyFrom(M);
      Sample.Unweld(Math.PI / 24, false);
      Mesh[] pieces = Sample.ExplodeAtUnweldedEdges();
      int k = pieces.Length;
      Color[] colors = new Color[k];
      for(int kk = 0;kk < k;kk++)
      {colors[kk] = C;}
      Ms = pieces;
      Cs = colors;
    }else
    {
      Ms = M;
      Cs = C;
    }


    //    Mesh Sample = new Mesh();
    //    Sample.CopyFrom(M);
    //
    //    Sample.Unweld(0, false);
    //    A = Sample.ExplodeAtUnweldedEdges();
    //    //A = Sample.SplitDisjointPieces();
# ---------- end cracklargemeshes ----------

# ---- group: Will take several minutes
mesh_2 = Mesh(cracklargemeshes.Ms)
col = Colour(cracklargemeshes.Cs)

# ---- group: 1D input
sy_2 = Z(Slider(0.8, range=0..1))
sz_2 = U(Slider(0.8, range=0..1))
_1d_input_curve = Curve(topoly.Polyline)
sx_2 = Y(Slider(0.8, range=0..1))
panel_4 = Panel("Curve to Voxels")  # disabled
value_list_2 = ValueList({"26-Connected": 26, "6-Connected": 6}, selected="6-Connected")
curvetovoxels = CSharpScript(CO=value_list_2, Crv=_1d_input_curve, Sx=sx_2, Sy=sy_2, Sz=sz_2)  # -> out, V, S; inputs CO: Int32, Crv: Polyline, Sx: Double, Sy: Double, Sz: Double
# ---------- curvetovoxels: C# ----------
    //    Vector3d VSize = new Vector3d(Sx, Sy, Sz);
    //    BoundingBox RBBox = Crv.GetBoundingBox(false);
    //    BoundingBox ZBBox = RBBox_to_ZBBox(RBBox, VSize);
    //    //A = ZBBox
    //    List<Point3d> gridpoints = BBoxToVoxels(ZBBox, VSize);
    //    //B = Gridpoints
    //    List<Mesh> Intargets = new List<Mesh>();
    //    List<Point3d> Voxels = new List<Point3d>();
    //    int[] Facets = null;
    //    Mesh Intarget = null;
    //    List<Point3d> Crv_NearPoints = NearPoints(gridpoints, Crv, VSize.Length / 2);
    //    //print(Crv_NearPoints.count)
    //    foreach (Point3d gridpoint in Crv_NearPoints)
    //    {
    //      if (CO == 26)
    //      {
    //        Intarget = LineTarget26_Connected(gridpoint, VSize);
    //      }
    //      else if (CO == 6)
    //      {
    //        Intarget = LineTarget6_Connected(gridpoint, VSize);
    //      }
    //      else
    //      {
    //        throw new Exception("connectivity target undefined!");
    //      }
    //      Polyline PL = new Polyline();
    //      Crv.TryGetPolyline(out PL);
    //      if (Rhino.Geometry.Intersect.Intersection.MeshPolyline(Intarget, PL, out Facets).Length > 0)
    //      {
    //        Voxels.Add(gridpoint);
    //      }
    //    }
    //B = Intargets
    Vector3d VSize = new Vector3d(Sx, Sy, Sz);
    V = VoxelizePolyline(CO, Crv, Sx, Sy, Sz);
    S = VSize;
# ---------- curvetovoxels: C# additional code ----------
  public object VoxelizePolyline(int CO, Polyline Crv, double Sx, double Sy, double Sz)
  {
    //A = MeshToTriangles(M)
    Vector3d VSize = new Vector3d(Sx, Sy, Sz);
    BoundingBox RBBox = Crv.BoundingBox;//GetBoundingBox(false);
    BoundingBox ZBBox = RBBox_to_ZBBox(RBBox, VSize);
    //A = ZBBox
    List<Point3d> gridpoints = BBoxToVoxels(ZBBox, VSize);
    //B = Gridpoints
    List<Mesh> Intargets = new List<Mesh>();
    List<Point3d> Voxels = new List<Point3d>();
    int[] Facets = null;
    Mesh Intarget = null;
    List<Point3d> Crv_NearPoints = NearPoints(gridpoints, Crv.ToNurbsCurve(), VSize.Length / 2);
    //print(Crv_NearPoints.count)
    foreach (Point3d gridpoint in Crv_NearPoints) {
      if (CO == 26) {
        Intarget = LineTarget26_Connected(gridpoint, VSize);
      } else if (CO == 6) {
        Intarget = LineTarget6_Connected(gridpoint, VSize);
      } else {
        Print("connectivity target undefined!");
      }
      if (Rhino.Geometry.Intersect.Intersection.MeshPolyline(Intarget, new PolylineCurve(Crv.GetRange(0, Crv.Count)), out Facets).Length > 0) {
        Voxels.Add(gridpoint);
      }
    }
    //B = Intargets
    return Voxels;
  }
  public Mesh[] MeshToTriangles(Mesh M)
  {
    M.Faces.ConvertQuadsToTriangles();
    Mesh[] Meshes = null;
    M.Unweld(0, false);
    Meshes = M.ExplodeAtUnweldedEdges();
    return Meshes;
  }
  public BoundingBox RBBox_to_ZBBox(BoundingBox RBbox, Vector3d VSize)
  {
    Point3d ZMinP = MinBoundRP_to_ZP(RBbox.Min, VSize);
    Point3d ZMaxP = MaxBoundRP_to_ZP(RBbox.Max, VSize);
    BoundingBox ZBBox = new BoundingBox(ZMinP, ZMaxP);
    return ZBBox;
  }
  public Point3d RPtoZP(Point3d RPoint, Vector3d VSize)
  {
    Point3d ZPOint = new Point3d((Math.Floor(RPoint.X / VSize.X) + 0.5) * VSize.X, (Math.Floor(RPoint.Y / VSize.Y) + 0.5) * VSize.Y, (Math.Floor(RPoint.Z) / VSize.Z + 0.5) * VSize.Z);
    return ZPOint;
  }
  private Point3d MaxBoundRP_to_ZP(Point3d RPoint, Vector3d VSize)
  {
    double x = 0;            double y = 0;            double z = 0;
    double u = 0;            double v = 0;            double w = 0;

    double ZP_x = 0;            double ZP_y = 0;            double ZP_z = 0;

    x = RPoint.X;            y = RPoint.Y;            z = RPoint.Z;

    u = VSize.X;            v = VSize.Y;            w = VSize.Z;

    ZP_x = Math.Ceiling(x / u) * u;            ZP_y = Math.Ceiling(y / v) * v;            ZP_z = Math.Ceiling(z / w) * w;
    Point3d ZPoint = new Point3d(ZP_x, ZP_y, ZP_z);
    return ZPoint;
  }
  private Point3d MinBoundRP_to_ZP(Point3d RPoint, Vector3d VSize)
  {
    double x = 0;            double y = 0;            double z = 0;
    double u = 0;            double v = 0;            double w = 0;
    double ZP_x = 0;            double ZP_y = 0;            double ZP_z = 0;
    x = RPoint.X;            y = RPoint.Y;            z = RPoint.Z;
    u = VSize.X;            v = VSize.Y;            w = VSize.Z;
    ZP_x = Math.Floor(x / u) * u;            ZP_y = Math.Floor(y / v) * v;            ZP_z = Math.Floor(z / w) * w;
    Point3d ZPoint = new Point3d(ZP_x, ZP_y, ZP_z);
    return ZPoint;
  }
  public List<Point3d> BBoxToVoxels(BoundingBox ZBBox, Vector3d Vsize)
  {
    int i = 0;            int j = 0;            int k = 0;
    int Imax = 0;            int Jmax = 0;            int Kmax = 0;
    Imax = Convert.ToInt32(Math.Abs(ZBBox.Diagonal.X / Vsize.X) - 1);
    Jmax = Convert.ToInt32(Math.Abs(ZBBox.Diagonal.Y / Vsize.Y) - 1);
    Kmax = Convert.ToInt32(Math.Abs(ZBBox.Diagonal.Z / Vsize.Z) - 1);
    //Dim VoxelPoints(IMax,JMax,KMax) As Point3d
    List<Point3d> VoxelPoints = new List<Point3d>();
    for (k = 0; k <= Kmax; k++)
    {
      for (j = 0; j <= Jmax; j++)
      {
        for (i = 0; i <= Imax; i++)
        {
          Point3d RelPoint = new Point3d(i * Vsize.X, j * Vsize.Y, k * Vsize.Z);
          //VoxelPoints(i, j, k) = (RelPoint + New Vector3d(ZBbox.Min) + New Vector3d(VSize(0), VSize(1), VSize(2)) * 0.5)
          VoxelPoints.Add((RelPoint + new Vector3d(ZBBox.Min) + new Vector3d(Vsize[0], Vsize[1], Vsize[2]) * 0.5));
        }
      }
    }
    return VoxelPoints;
  }
  public Mesh LineTarget26_Connected(Point3d VoxelPoint, Vector3d Vsize)
  {
    Mesh IntersectionTarget = new Mesh();
    Point3d[] Vertices = new Point3d[19];
    double u = 0;
    double v = 0;
    double w = 0;
    u = Vsize.X / 2;
    v = Vsize.Y / 2;
    w = Vsize.Z / 2;

    Vertices[00] = VoxelPoint;
    Vertices[01] = VoxelPoint + new Vector3d(+u, 0, 0);
    Vertices[02] = VoxelPoint + new Vector3d(0, +v, 0);
    Vertices[03] = VoxelPoint + new Vector3d(0, 0, +w);
    Vertices[04] = VoxelPoint + new Vector3d(+u, +v, 0);
    Vertices[05] = VoxelPoint + new Vector3d(0, +v, +w);
    Vertices[06] = VoxelPoint + new Vector3d(+u, 0, +w);
    Vertices[07] = VoxelPoint - new Vector3d(+u, 0, 0);
    Vertices[08] = VoxelPoint - new Vector3d(0, +v, 0);
    Vertices[09] = VoxelPoint - new Vector3d(0, 0, +w);
    Vertices[10] = VoxelPoint - new Vector3d(+u, +v, 0);
    Vertices[11] = VoxelPoint - new Vector3d(0, +v, +w);
    Vertices[12] = VoxelPoint - new Vector3d(+u, 0, +w);
    Vertices[13] = VoxelPoint + new Vector3d(+u, -v, 0);
    Vertices[14] = VoxelPoint + new Vector3d(-u, +v, 0);
    Vertices[15] = VoxelPoint + new Vector3d(+u, 0, -w);
    Vertices[16] = VoxelPoint + new Vector3d(-u, 0, +w);
    Vertices[17] = VoxelPoint + new Vector3d(0, +v, -w);
    Vertices[18] = VoxelPoint + new Vector3d(0, -v, +w);

    Rhino.Geometry.Collections.MeshFaceList Faces = IntersectionTarget.Faces;
    Faces.AddFace(0, 1, 4, 2);
    //xy
    Faces.AddFace(0, 2, 14, 7);
    //xy
    Faces.AddFace(0, 7, 10, 8);
    //xy
    Faces.AddFace(0, 8, 13, 1);
    //xy

    Faces.AddFace(0, 1, 6, 3);
    //xz
    Faces.AddFace(0, 3, 16, 7);
    //xZ
    Faces.AddFace(0, 7, 12, 9);
    //xz
    Faces.AddFace(0, 9, 15, 1);
    //xz

    Faces.AddFace(0, 2, 5, 3);
    //yZ
    Faces.AddFace(0, 3, 18, 8);
    //yz
    Faces.AddFace(0, 8, 11, 9);
    //yz
    Faces.AddFace(0, 9, 17, 2);
    //yz

    IntersectionTarget.Vertices.AddVertices(Vertices);
    IntersectionTarget.Faces.AddFaces(Faces);

    return IntersectionTarget;
  }
  public Mesh LineTarget6_Connected(Point3d VoxelPoint, Vector3d Vsize)
  {
    Mesh IntersectionTarget = new Mesh();
    Point3d[] Vertices = new Point3d[9];
    double u = 0;
    double v = 0;
    double w = 0;
    u = Vsize.X / 2;
    v = Vsize.Y / 2;
    w = Vsize.Z / 2;

    Vertices[0] = VoxelPoint;
    Vertices[1] = VoxelPoint - new Vector3d(+u, +v, +w);
    Vertices[2] = VoxelPoint - new Vector3d(-u, +v, +w);
    Vertices[3] = VoxelPoint - new Vector3d(-u, -v, +w);
    Vertices[4] = VoxelPoint - new Vector3d(+u, -v, +w);
    Vertices[5] = VoxelPoint + new Vector3d(-u, -v, +w);
    Vertices[6] = VoxelPoint + new Vector3d(+u, -v, +w);
    Vertices[7] = VoxelPoint + new Vector3d(+u, +v, +w);
    Vertices[8] = VoxelPoint + new Vector3d(-u, +v, +w);

    Rhino.Geometry.Collections.MeshFaceList Faces = IntersectionTarget.Faces;

    Faces.AddFace(0, 1, 2);
    Faces.AddFace(0, 2, 6);
    Faces.AddFace(0, 6, 5);
    Faces.AddFace(0, 5, 1);
    Faces.AddFace(0, 4, 1);
    Faces.AddFace(0, 5, 8);
    Faces.AddFace(0, 8, 7);
    Faces.AddFace(0, 7, 3);
    Faces.AddFace(0, 3, 4);
    Faces.AddFace(0, 4, 8);
    Faces.AddFace(0, 7, 6);
    Faces.AddFace(0, 2, 3);

    IntersectionTarget.Vertices.AddVertices(Vertices);
    IntersectionTarget.Faces.AddFaces(Faces);

    return IntersectionTarget;
  }
  public List<Point3d> NearPoints(List<Point3d> x, Curve y, double Distance)
  {
    List<Point3d> AllPoints = x;
    double t = 0;
    List<Point3d> RelevantPoints = AllPoints.FindAll(lambda => y.ClosestPoint(lambda, out t, Distance));
    return RelevantPoints;
  }
  public object NearPoints(List<Point3d> x, Mesh y, double Distance)
  {
    List<Point3d> AllPoints = x;
    Point3d MP = default(Point3d);
    List<Point3d> RelevantPoints = AllPoints.FindAll(lambda => !((y.ClosestPoint(lambda, out MP, Distance)) == -1));
    return RelevantPoints;
  }
# ---------- end curvetovoxels ----------
topovoxels_2 = VBScript(CO=value_list_2, Crv=_1d_input_curve, Sx=sx_2, Sy=sy_2, Sz=sz_2)  # -> out, V, S; inputs Crv: Curve
# ---------- topovoxels_2: VB ----------
    Dim VSize As  New Vector3d(Sx, Sy, Sz)
    V = VoxelizePolyline(CO, Crv, Sx, Sy, Sz)
    S = Vsize
# ---------- topovoxels_2: VB additional code ----------
  Function VoxelizePolyline(ByVal CO As Integer, ByVal Crv As Curve, ByVal Sx As Double, ByVal Sy As Double, ByVal Sz As Double)
    'A = MeshToTriangles(M)
    Dim VSize As  New Vector3d(Sx, Sy, Sz)
    Dim RBBox As Boundingbox = Crv.GetBoundingBox(False)
    Dim ZBBox As boundingbox = RBBox_to_ZBBox(RBBox, VSize)
    'A = ZBBox
    Dim gridpoints As list(Of point3d) = BBoxToVoxels(ZBBox, Vsize)
    'B = Gridpoints
    Dim Intargets As New list(Of Mesh)
    Dim Voxels As New list(Of Point3d)
    Dim Facets As Integer()=Nothing
    Dim Intarget As mesh = Nothing
    Dim Crv_NearPoints As List(Of point3d) = NearPoints(gridpoints, Crv, Vsize.Length / 2)
    'print(Crv_NearPoints.count)
    For Each gridpoint As point3d In Crv_NearPoints
      If CO = 26 Then
        Intarget = LineTarget26_Connected(gridpoint, VSize)
      ElseIf CO = 6 Then
        Intarget = LineTarget6_Connected(gridpoint, VSize)
      Else
        print("connectivity target undefined!")
      End If
      If Rhino.Geometry.Intersect.Intersection.MeshPolyline(Intarget, Crv, Facets).Length > 0 Then
        Voxels.Add(GridPoint)
      End If
    Next
    'B = Intargets
    Return Voxels
  End Function
  Function MeshToTriangles(ByVal M As Mesh) As Mesh()
    M.Faces.ConvertQuadsToTriangles
    Dim Meshes As Mesh()
    M.Unweld(0, False)
    Meshes = M.ExplodeAtUnweldedEdges()
    Return Meshes
  End Function
  Function RBBox_to_ZBBox(RBbox As BoundingBox, VSize As Vector3d) As Boundingbox
    Dim ZMinP As point3d = MinBoundRP_to_ZP(RBBox.Min, VSize)
    Dim ZMaxP As point3d = MaxBoundRP_to_ZP(RBBox.Max, VSize)
    Dim ZBBox As New BoundingBox(ZMinP, ZMaxP)
    Return ZBBox
  End Function
  Function RPtoZP(RPoint As point3d, VSize As Vector3d) As point3d
    Dim ZPOint As New Point3d((Math.Floor(RPoint.x / VSize.X) + 0.5) * VSize.X, (Math.Floor(RPoint.y / VSize.Y) + 0.5) * VSize.Y, (Math.Floor(Rpoint.z) / VSize.Z + 0.5) * VSize.Z)
    Return ZPoint
  End Function
  Private Function MaxBoundRP_to_ZP(RPoint As point3d, VSize As Vector3d)
    Dim x,y,z,u,v,w,ZP_x,ZP_y,ZP_z As Double
    x = Rpoint.x
    y = RPoint.Y
    z = RPoint.z
    u = Vsize.X
    v = Vsize.Y
    w = Vsize.Z
    ZP_x = Math.Ceiling(x / u) * u
    ZP_y = Math.Ceiling(y / v) * v
    ZP_z = Math.Ceiling(z / w) * w
    Dim ZPoint As New Point3d(ZP_x, ZP_y, ZP_z)
    Return ZPoint
  End Function
  Private Function MinBoundRP_to_ZP(RPoint As point3d, VSize As Vector3d)
    Dim x,y,z,u,v,w,ZP_x,ZP_y,ZP_z As Double
    x = Rpoint.x
    y = RPoint.Y
    z = RPoint.z
    u = Vsize.X
    v = Vsize.Y
    w = Vsize.Z
    ZP_x = Math.Floor(x / u) * u
    ZP_y = Math.Floor(y / v) * v
    ZP_z = Math.Floor(z / w) * w
    Dim ZPoint As New Point3d(ZP_x, ZP_y, ZP_z)
    Return ZPoint
  End Function
  Function BBoxToVoxels(ZBBox As boundingbox, Vsize As Vector3d) As list(Of point3d)
    Dim i,j,k,Imax, Jmax, Kmax As Integer
    IMax = Math.Abs(ZBBox.Diagonal.X / Vsize.x) - 1
    JMax = Math.Abs(ZBBox.Diagonal.Y / Vsize.y) - 1
    KMax = Math.Abs(ZBBox.Diagonal.Z / Vsize.z) - 1
    'Dim VoxelPoints(IMax,JMax,KMax) As Point3d
    Dim VoxelPoints As New list(Of point3d)
    For k = 0 To Kmax
      For j = 0 To Jmax
        For i = 0 To IMax
          Dim RelPoint As New Point3d(i * VSize.x, j * VSize.y, k * Vsize.z)
          'VoxelPoints(i, j, k) = (RelPoint + New Vector3d(ZBbox.Min) + New Vector3d(VSize(0), VSize(1), VSize(2)) * 0.5)
          VoxelPoints.Add((RelPoint + New Vector3d(ZBbox.Min) + New Vector3d(VSize(0), VSize(1), VSize(2)) * 0.5))
        Next
      Next
    Next
    Return VoxelPoints
  End Function
  Function LineTarget26_Connected(VoxelPoint As Point3d, Vsize As Vector3d)
    Dim IntersectionTarget As New Mesh
    Dim Vertices(18) As Point3d
    Dim u,v,w As Double
    u = VSize.X / 2
    v = Vsize.Y / 2
    w = Vsize.Z / 2

    Vertices(00) = VoxelPoint
    Vertices(01) = VoxelPoint + New Vector3d(+u, 00, 00)
    Vertices(02) = VoxelPoint + New Vector3d(00, +v, 00)
    Vertices(03) = VoxelPoint + New Vector3d(00, 00, +w)
    Vertices(04) = VoxelPoint + New Vector3d(+u, +v, 00)
    Vertices(05) = VoxelPoint + New Vector3d(00, +v, +w)
    Vertices(06) = VoxelPoint + New Vector3d(+u, 00, +w)
    Vertices(07) = VoxelPoint - New Vector3d(+u, 00, 00)
    Vertices(08) = VoxelPoint - New Vector3d(00, +v, 00)
    Vertices(09) = VoxelPoint - New Vector3d(00, 00, +w)
    Vertices(10) = VoxelPoint - New Vector3d(+u, +v, 00)
    Vertices(11) = VoxelPoint - New Vector3d(00, +v, +w)
    Vertices(12) = VoxelPoint - New Vector3d(+u, 00, +w)
    Vertices(13) = VoxelPoint + New Vector3d(+u, -v, 00)
    Vertices(14) = VoxelPoint + New Vector3d(-u, +v, 00)
    Vertices(15) = VoxelPoint + New Vector3d(+u, 00, -w)
    Vertices(16) = VoxelPoint + New Vector3d(-u, 00, +w)
    Vertices(17) = VoxelPoint + New Vector3d(00, +v, -w)
    Vertices(18) = VoxelPoint + New Vector3d(00, -v, +w)

    Dim Faces = IntersectionTarget.Faces
    Faces.AddFace(00, 01, 04, 02) 'xy
    Faces.AddFace(00, 02, 14, 07) 'xy
    Faces.AddFace(00, 07, 10, 08) 'xy
    Faces.AddFace(00, 08, 13, 01) 'xy

    Faces.AddFace(00, 01, 06, 03) 'xz
    Faces.AddFace(00, 03, 16, 07) 'xZ
    Faces.AddFace(00, 07, 12, 09) 'xz
    Faces.AddFace(00, 09, 15, 01) 'xz

    Faces.AddFace(00, 02, 05, 03) 'yZ
    Faces.AddFace(00, 03, 18, 08) 'yz
    Faces.AddFace(00, 08, 11, 09) 'yz
    Faces.AddFace(00, 09, 17, 02) 'yz

    IntersectionTarget.Vertices.AddVertices(Vertices)
    IntersectionTarget.Faces.AddFaces(Faces)

    Return IntersectionTarget
  End Function
  Function LineTarget6_Connected(VoxelPoint As Point3d, Vsize As Vector3d)
    Dim IntersectionTarget As New Mesh
    Dim Vertices(8) As Point3d
    Dim u,v,w As Double
    u = VSize.X / 2
    v = Vsize.Y / 2
    w = Vsize.Z / 2

    Vertices(0) = VoxelPoint
    Vertices(1) = VoxelPoint - New Vector3d(+u, +v, +w)
    Vertices(2) = VoxelPoint - New Vector3d(-u, +v, +w)
    Vertices(3) = VoxelPoint - New Vector3d(-u, -v, +w)
    Vertices(4) = VoxelPoint - New Vector3d(+u, -v, +w)
    Vertices(5) = VoxelPoint + New Vector3d(-u, -v, +w)
    Vertices(6) = VoxelPoint + New Vector3d(+u, -v, +w)
    Vertices(7) = VoxelPoint + New Vector3d(+u, +v, +w)
    Vertices(8) = VoxelPoint + New Vector3d(-u, +v, +w)

    Dim Faces = IntersectionTarget.Faces

    Faces.AddFace(0, 1, 2)
    Faces.AddFace(0, 2, 6)
    Faces.AddFace(0, 6, 5)
    Faces.AddFace(0, 5, 1)
    Faces.AddFace(0, 4, 1)
    Faces.AddFace(0, 5, 8)
    Faces.AddFace(0, 8, 7)
    Faces.AddFace(0, 7, 3)
    Faces.AddFace(0, 3, 4)
    Faces.AddFace(0, 4, 8)
    Faces.AddFace(0, 7, 6)
    Faces.AddFace(0, 2, 3)

    IntersectionTarget.Vertices.AddVertices(Vertices)
    IntersectionTarget.Faces.AddFaces(Faces)

    Return IntersectionTarget
  End Function
  Function NearPoints(ByVal x As List(Of Point3d), ByVal y As Curve, Distance As Double) As list(Of point3d)
    Dim AllPoints As list(Of Point3d) = x
    Dim t As Double
    Dim RelevantPoints As list(Of Point3d) = AllPoints.findAll(Function(lambda) y.closestPoint(lambda, t, Distance))
    Return RelevantPoints
  End Function
  Function NearPoints(ByVal x As List(Of Point3d), ByVal y As Mesh, Distance As Double)
    Dim AllPoints As list(Of Point3d) = x
    Dim MP As point3d
    Dim RelevantPoints As list(Of Point3d) = AllPoints.findAll(Function(lambda) Not y.closestPoint(lambda, MP, Distance))
    Return RelevantPoints
  End Function
# ---------- end topovoxels_2 ----------
boxels_3 = VBScript(V=curvetovoxels.V, S=curvetovoxels.S)  # -> out, B; inputs V: list of Point3d, S: Vector3d; same code as boxels
mv_3 = MV(G=boxels_3.B)

# ----
mesh_3 = Mesh(mesh)
col_2 = Colour(swatch)
path = FilePath(format)
c_script_2 = CSharpScript(x=mesh_3)  # -> out, A; inputs x: Mesh
# ---------- c_script_2: C# ----------
    x.Faces.ConvertQuadsToTriangles();
    x.FaceNormals.ComputeFaceNormals();
    A = x;
# ---------- end c_script_2 ----------
panel_5 = Panel(cracklargemeshes.out)
value_list_3 = ValueList({"26-Connected": 26, "6-Connected": 6}, selected="26-Connected")
batchvoxelate_c__independent = CSharpScript(CO=value_list_3, ObjM=c_script_2.A, ObjC=col_2, FPath=path, Sx=sx, Sy=sy, Sz=sz)  # -> out, A; inputs CO: Int32, ObjM: list of Mesh, ObjC: list of Color, FPath: String, Sx: Double, Sy: Double, Sz: Double
# ---------- batchvoxelate_c__independent: C# ----------
    List<Mesh> Meshes = ObjM;
    List<Color> Colors = ObjC;

    Vector3d VSize = new Vector3d(Sx, Sy, Sz);

    double Distance = VSize.Length / 2;

    List<Tuple<int, double, double, double, byte, byte, byte>> VT = new List<Tuple<int, double, double, double, byte, byte, byte>>();
    //Voxel Tuples'List(Of String())'
    PointCloud VPC = new PointCloud();
    //VoxelPointCloud
    for (int i = 0; i <= ObjM.Count - 1; i++) {
      VT.AddRange(VoxelizeMesh(Meshes[i], Colors[i], i, VSize, CO, ref VPC));
    }

    System.IO.StreamWriter SW = File.CreateText(FPath);
    string result = "";
    //k As Integer=0 To VT.count - 1'String() In VT'
    foreach (Tuple<int, double, double, double, byte, byte, byte> vtp in VT) {
      result = vtp.Item1 + "," + vtp.Item2 + "," + vtp.Item3 + "," + vtp.Item4 + "," + vtp.Item5 + "," + vtp.Item6 + "," + vtp.Item7;
      //String.Join(",", vtp) 'vtp.toString'
      SW.WriteLine(result);
    }
    SW.Close();

    PCloud = null;
    PCloud = VPC;
# ---------- batchvoxelate_c__independent: C# additional code ----------
  private PointCloud PCloud = null;
  public override void DrawViewportMeshes(IGH_PreviewArgs args)
  {
    args.Display.DrawPointCloud(PCloud, 10);
  }
  public List<Tuple<int, double, double, double, byte, byte, byte>> VoxelizeMesh(Mesh M, Color MC, int M_ID, Vector3d Vsize, int CO, ref PointCloud VPC)
  {
    //{ID,X,Y,Z,R,G,B}
    BoundingBox RBBox = M.GetBoundingBox(false);
    //bounding box in R3 (real numbers)
    BoundingBox ZBBox = RBBox_to_ZBBox(RBBox, Vsize);
    //boudning box in Z3 (integer numbers) (note that they are again embedded in R3 for visualization)

    List<Point3d> gridpoints = BBoxToVoxels(ZBBox, Vsize);

    List<Point3d> Mesh_NearPoints = NearPoints(gridpoints, M, Vsize.Length / 2);
    //A = Mesh_NearPoints
    List<Tuple<int, double, double, double, byte, byte, byte>> Voxels = new List<Tuple<int, double, double, double, byte, byte, byte>>();
    //{ID,X,Y,Z,R,G,B}

    Line[] Intarget = null;
    //int[] Facets = null;
    // for each potential voxel check if it has to be included in the raster
    foreach (Point3d gp in Mesh_NearPoints) {
      if (CO == 26) {
        Intarget = MeshTarget26_Connected(gp, Vsize);
      } else if (CO == 6) {
        Intarget = MeshTarget06_Connected(gp, Vsize);
      } else {
        RhinoApp.WriteLine("connectivity target undefined!");
      }
      //Line[] Intersections = Array.FindAll(Intarget, lambda => MeshLineIntersect(M, lambda));
      if (Array.Exists(Intarget, lambda => MeshLineIntersect(M, lambda))) {
        Voxels.Add(Tuple.Create(M_ID, gp.X, gp.Y, gp.Z, MC.R, MC.G, MC.B));
        VPC.Add(gp, MC);
      }
    }
    return Voxels;
  }
  public Mesh[] MeshToTriangles(Mesh M) //not necessary perhaps; just in case... a utility function
  {
    M.Faces.ConvertQuadsToTriangles();
    Mesh[] Meshes = null;
    M.Unweld(0, false);
    Meshes = M.ExplodeAtUnweldedEdges();
    return Meshes;
  }
  public BoundingBox RBBox_to_ZBBox(BoundingBox RBbox, Vector3d VSize) // converts a bounding box given in R3 to a bounding box in Z3 that is bigger than or the same size as the one given in R3
  {
    Point3d ZMinP = MinBoundRP_to_ZP(RBbox.Min, VSize);
    Point3d ZMaxP = MaxBoundRP_to_ZP(RBbox.Max, VSize);
    BoundingBox ZBBox = new BoundingBox(ZMinP, ZMaxP);
    return ZBBox;
  }
  public Point3d RPtoZP(Point3d RPoint, Vector3d VSize) // finds the closest Z3 point to an R3 point
  {
    Point3d ZPOint = new Point3d((Math.Floor(RPoint.X / VSize.X) + 0.5) * VSize.X, (Math.Floor(RPoint.Y / VSize.Y) + 0.5) * VSize.Y, (Math.Floor(RPoint.Z) / VSize.Z + 0.5) * VSize.Z);
    return ZPOint;
  }
  private Point3d MaxBoundRP_to_ZP(Point3d RPoint, Vector3d VSize) //snaps a boundingbox Maximum Corner point embedded in R3 to a point in Z3 ensuring a bounding box in Z3 that is bigger than or the same size as the bounding box in R3
  {
    double x = 0;double y = 0;double z = 0;
    double u = 0;double v = 0;double w = 0;
    double ZP_x = 0;
    double ZP_y = 0;
    double ZP_z = 0;
    x = RPoint.X;
    y = RPoint.Y;
    z = RPoint.Z;
    u = VSize.X;
    v = VSize.Y;
    w = VSize.Z;
    ZP_x = Math.Ceiling(x / u) * u;
    ZP_y = Math.Ceiling(y / v) * v;
    ZP_z = Math.Ceiling(z / w) * w;
    Point3d ZPoint = new Point3d(ZP_x, ZP_y, ZP_z);
    return ZPoint;
  }
  private Point3d MinBoundRP_to_ZP(Point3d RPoint, Vector3d VSize) //snaps a boundingbox Minimum Corner point embedded in R3 to a point in Z3 ensuring a bounding box in Z3 that is bigger than or the same size as the bounding box in R3
  {
    double x = 0;double y = 0;double z = 0;
    double u = 0;double v = 0;double w = 0;
    double ZP_x = 0;
    double ZP_y = 0;
    double ZP_z = 0;
    x = RPoint.X;
    y = RPoint.Y;
    z = RPoint.Z;
    u = VSize.X;
    v = VSize.Y;
    w = VSize.Z;
    ZP_x = Math.Floor(x / u) * u;
    ZP_y = Math.Floor(y / v) * v;
    ZP_z = Math.Floor(z / w) * w;
    Point3d ZPoint = new Point3d(ZP_x, ZP_y, ZP_z);
    return ZPoint;
  }
  public List<Point3d> BBoxToVoxels(BoundingBox ZBBox, Vector3d Vsize) //Creates a List of voxels that correspond to a boundingbox described in Z3 space
  {
    int i = 0;
    int j = 0;
    int k = 0;
    int Imax = 0;
    int Jmax = 0;
    int Kmax = 0;
    Imax = Convert.ToInt32(Math.Abs(ZBBox.Diagonal.X / Vsize.X) - 1);
    Jmax = Convert.ToInt32(Math.Abs(ZBBox.Diagonal.Y / Vsize.Y) - 1);
    Kmax = Convert.ToInt32(Math.Abs(ZBBox.Diagonal.Z / Vsize.Z) - 1);
    //Dim VoxelPoints(IMax,JMax,KMax) As Point3d
    List<Point3d> VoxelPoints = new List<Point3d>();
    for (k = 0; k <= Kmax; k++) {
      for (j = 0; j <= Jmax; j++) {
        for (i = 0; i <= Imax; i++) {
          Point3d RelPoint = new Point3d(i * Vsize.X, j * Vsize.Y, k * Vsize.Z);
          //VoxelPoints(i, j, k) = (RelPoint + New Vector3d(ZBbox.Min) + New Vector3d(VSize(0), VSize(1), VSize(2)) * 0.5)
          VoxelPoints.Add((RelPoint + new Vector3d(ZBBox.Min) + new Vector3d(Vsize[0], Vsize[1], Vsize[2]) * 0.5));
        }
      }
    }
    return VoxelPoints;
  }
  public Line[] MeshTarget26_Connected(Point3d VoxelPoint, Vector3d Vsize) ////makes a target for intersection with a mesh that ensures 26-connected results as proven by Samuli Laine 2013, NVIDIA Research: this is the set of a cube's diagons
  {
    //3D crosshair target for 26-connected results
    Line[] IntersectionTarget = new Line[3];
    Point3d[] Vertices = new Point3d[6];
    double u = 0;
    double v = 0;
    double w = 0;
    u = Vsize.X / 2;
    v = Vsize.Y / 2;
    w = Vsize.Z / 2;
    Vertices[0] = VoxelPoint + new Vector3d(+u, 0, 0);
    Vertices[1] = VoxelPoint + new Vector3d(0, +v, 0);
    Vertices[2] = VoxelPoint + new Vector3d(0, 0, +w);
    Vertices[3] = VoxelPoint + new Vector3d(-u, 0, 0);
    Vertices[4] = VoxelPoint + new Vector3d(0, -v, 0);
    Vertices[5] = VoxelPoint + new Vector3d(0, 0, -w);
    for (int i = 0; i <= 2; i++) {
      IntersectionTarget[i] = new Line(Vertices[i], Vertices[i + 3]);
    }
    return IntersectionTarget;
  }
  public Line[] MeshTarget06_Connected(Point3d VP, Vector3d Vsize) //makes a target for intersection with a mesh that ensures 06-connected results as proven by Samuli Laine 2013, NVIDIA Research: this is the outline wireframe of a cube
  {
    //cube outline target for 6-connected results
    Line[] IT = new Line[12];
    Point3d[] VX = new Point3d[8];
    double u = 0;
    double v = 0;
    double w = 0;
    u = Vsize.X / 2;
    v = Vsize.Y / 2;
    w = Vsize.Z / 2;

    VX[0] = VP + new Vector3d(+u, +v, +w);
    VX[1] = VP + new Vector3d(-u, +v, +w);
    VX[2] = VP + new Vector3d(-u, -v, +w);
    VX[3] = VP + new Vector3d(+u, -v, +w);
    VX[4] = VP + new Vector3d(-u, -v, -w);
    VX[5] = VP + new Vector3d(+u, -v, -w);
    VX[6] = VP + new Vector3d(+u, +v, -w);
    VX[7] = VP + new Vector3d(-u, +v, -w);
    //cube edges
    IT[00] = new Line(VX[0], VX[1]);
    IT[01] = new Line(VX[1], VX[2]);
    IT[02] = new Line(VX[2], VX[3]);
    IT[03] = new Line(VX[3], VX[0]);
    IT[04] = new Line(VX[0], VX[6]);
    IT[05] = new Line(VX[6], VX[5]);
    IT[06] = new Line(VX[5], VX[4]);
    IT[07] = new Line(VX[4], VX[7]);
    IT[08] = new Line(VX[5], VX[3]);
    IT[09] = new Line(VX[4], VX[2]);
    IT[10] = new Line(VX[1], VX[7]);
    IT[11] = new Line(VX[6], VX[7]);
    return IT;
  }
  public List<Point3d> NearPoints(List<Point3d> x, Mesh y, double Distance) //finds the voxel centrepoints that could be relevant as to their distance towards the mesh, which is to be voxelized.
  {
    List<Point3d> AllPoints = x;
    Point3d MP = default(Point3d);
    List<Point3d> RelevantPoints = AllPoints.FindAll(lambda => y.ClosestPoint(lambda, out MP, Distance) != -1);
    return RelevantPoints;
  }
  public List<Point3d> NearPoints(List<Point3d> x, Curve y, double Distance) //finds the voxel centrepoints that could be relevant as to their distance towards the curve, which is to be voxelized.
  {
    List<Point3d> AllPoints = x;
    double t = 0;
    List<Point3d> RelevantPoints = AllPoints.FindAll(lambda => y.ClosestPoint(lambda, out t, Distance));
    return RelevantPoints;
  }
  public bool MeshLineIntersect(Rhino.Geometry.Mesh x, Rhino.Geometry.Line L) //this is now for reading triangles from Rhino Mesh objects; can be eventually replaced with something, which reads OBJ mesh objects
  {
    List<Point3d[]> TVs = new List<Point3d[]>();
    //List of Triangle Vertices
    Point3d[] TV = new Point3d[3];
    //Triangle Vertices
    Point3f av = default(Point3f);
    Point3f bv = default(Point3f);
    Point3f cv = default(Point3f);
    Point3f dv = default(Point3f);

    //Each face As MeshFace In x.Faces
    for (int k = 0; k <= x.Faces.Count - 1; k++) {
      x.Faces.GetFaceVertices(k, out av, out bv, out cv, out dv);
      TV = new Point3d[] {new Point3d(av), new Point3d(bv),new Point3d(cv)};
      TVs.Add(TV);
    }
    return TVs.Exists(Lambda => TriangleLineIntersect(Lambda, L));
  }
  public bool TriangleLineIntersect(Rhino.Geometry.Point3d[] Vx, Rhino.Geometry.Line L)
  {
    if (Vx.Length != 3) {
      throw new Exception("Triangle is not valid!");
    }
    Point3d O = Vx[0];
    Vector3d U = Vx[1] - O;
    Vector3d V = Vx[2] - O;
    Vector3d N = Vector3d.CrossProduct(U, V);
    //plane normal

    Point3d PS = L.From;//start point of the line
    Point3d PE = L.To;  //end point of the line

    double Nomin = ((O - PS) * N);
    //operator * for dot product
    double Denom = N * (PE - PS);

    // only if the line is not paralell to the plane containing triangle T
    if (Denom != 0) {
      double alpha = Nomin / Denom;
      // parameter along the line where it intersects the plane in question, only if not paralell to the plane
      Point3d P = PS + alpha * (PE - PS);
      //L.PointAt(alpha) '

      Vector3d W = P - O;

      double UU = U * U;
      double VV = V * V;
      double UV = U * V;
      double WU = W * U;
      double WV = W * V;

      double STDenom = Math.Pow(UV, 2) - UU * VV;

      double s = (UV * WV - VV * WU) / STDenom;
      double t = (UV * WU - UU * WV) / STDenom;

      Point3d Point = O + s * U + t * V;

      if (s >= 0 & t >= 0 & s + t <= 1) {
        return true;
      } else {
        return false;
      }
    } else {
      return false;
    }
  }
  public bool TriangleLineIntersect(Rhino.Geometry.Point3d[] Vx, Rhino.Geometry.Vector3d Normal, Rhino.Geometry.Line L)
  {
    if (Vx.Length != 3) {
      throw new Exception("Triangle is not valid!");
    }
    Point3d O = Vx[0];
    Vector3d U = Vx[1] - O;
    Vector3d V = Vx[2] - O;
    Vector3d N = Normal;//Vector3d.CrossProduct(U, V);
    //plane normal

    Point3d PS = L.From;//start point of the line
    Point3d PE = L.To;  //end point of the line

    double Nomin = ((O - PS) * N);
    //operator * for dot product
    double Denom = N * (PE - PS);

    // only if the line is not paralell to the plane containing triangle T
    if (Denom != 0) {
      double alpha = Nomin / Denom;
      // parameter along the line where it intersects the plane in question, only if not paralell to the plane
      Point3d P = PS + alpha * (PE - PS);
      //L.PointAt(alpha) '

      Vector3d W = P - O;

      double UU = U * U;
      double VV = V * V;
      double UV = U * V;
      double WU = W * U;
      double WV = W * V;

      double STDenom = Math.Pow(UV, 2) - UU * VV;

      double s = (UV * WV - VV * WU) / STDenom;
      double t = (UV * WU - UU * WV) / STDenom;

      Point3d Point = O + s * U + t * V;

      if (s >= 0 & t >= 0 & s + t <= 1) {
        return true;
      } else {
        return false;
      }
    } else {
      return false;
    }
  }
# ---------- end batchvoxelate_c__independent ----------

# ==== cluster MV
G = ClusterInput()
medges = MeshEdges(Mesh=G)  # -> NakedEdges, InteriorEdges, NonManifoldEdges
merge = Merge(Data1=medges.NakedEdges, Data2=medges.InteriorEdges, Data3=medges.NonManifoldEdges)  # -> flatten(Result)
material = CreateMaterial(
    Diffuse=ColourSwatch(SwatchColor=RGB(83, 94, 94)),
    Specular=RGB(255, 255, 255),
    Emission=RGB(0, 0, 0),
    Transparency=Slider(0.826, range=0..1),
    Shine=0)
preview = CustomPreview(Geometry=G, Shader=material)
preview_2 = CustomPreview(Geometry=merge, Shader=ColourSwatch(SwatchColor=RGB(0, 0, 0)))

# ==== cluster E
M = ClusterInput()
tri = Triangulate(Mesh=M)  # -> Mesh, Count
medges = MeshEdges(Mesh=tri.Mesh)  # -> NakedEdges, InteriorEdges, NonManifoldEdges

# ==== cluster MV_2
G = ClusterInput()
medges = MeshEdges(Mesh=G)  # -> NakedEdges, InteriorEdges, NonManifoldEdges
number_slider = Slider(0.826, range=0..1)
merge = Merge(Data1=medges.NakedEdges, Data2=medges.InteriorEdges, Data3=medges.NonManifoldEdges)  # -> flatten(Result)
material = CreateMaterial(
    Diffuse=ColourSwatch(SwatchColor=RGB(83, 94, 94)),
    Specular=RGB(255, 255, 255),
    Emission=RGB(0, 0, 0),
    Transparency=0,
    Shine=0)
preview = CustomPreview(Geometry=G, Shader=material)
preview_2 = CustomPreview(Geometry=merge, Shader=ColourSwatch(SwatchColor=RGB(0, 0, 0)))
